% Simulink data dictionary buses.sldd

MasterToSlaveBus = Simulink.Bus(HeaderFile="bms_buses.h")
  enable_bal_8: double[8]

SlaveToMasterBus = Simulink.Bus(HeaderFile="bms_buses.h")
  V_cells_96: double[96]
  T_sensors_32: double[32]
  fault_flags_8: double[8]

VehicleOutputBus = Simulink.Bus(HeaderFile="bms_buses.h")
  V_pack: double
  P_limit_chg: double
  P_limit_dchg: double
  fault_severity: double
  shutdown_cmd: double
  SoC_pack: double

DiagOutputBus = Simulink.Bus(HeaderFile="bms_buses.h")
  V_pack: double
  P_limit_chg: double
  P_limit_dchg: double
  fault_severity: double
  shutdown_cmd: double
  SoC_pack: double
  SoH_pack: double
  I_pack: double
  T_pack: double
  T_coolant: double
  T_cell_min: double
  T_cell_max: double
  V_cell_min: double
  V_cell_max: double
  prob_3: double[3]
  alarm_3: double[3]
  P_heat_cmd: double
  P_chill_cmd: double
  enable_bal_8: double[8]